# Grasshopper definition SynthAnthro_SkeletalModel_3.gh (Grasshopper 1.0.8)

list = ValueList({"MALE", "FEMALE"}, selected="FEMALE")
path = FilePath("/Users/briancox/Dropbox/GitHub/MTWABP/Tools/SyntheticAnthropometry/CAESAR/OBJ/")
pyfourdigitoutput_1 = Python3Script(inputPath=path, inputGender=list, inputSlider=Slider(72, range=0..5000))  # -> out, outputFilePath
# ---------- pyfourdigitoutput_1: Python ----------
inputNumber = int(inputSlider)
outputFilePath = f"{inputPath}SPRING_{inputGender}/SPRING{inputNumber:04d}.obj"
# ---------- end pyfourdigitoutput_1 ----------
panel = Panel(pyfourdigitoutput_1.outputFilePath)
_3dm = Import3DM(File=pyfourdigitoutput_1.outputFilePath, Layer="*", Name="*")
scale = Scale(Geometry=_3dm, Center=Point(0, 0, 0), Factor=Slider(1000, range=0..1000))  # -> Geometry, Transform
geo = Geometry(scale.Geometry)
demesh = DeconstructMesh(Mesh=geo)  # -> Vertices, Faces, Colours, Normals
pt = Point(<point referenced from the Rhino model>)
cp = ClosestPoint(Point=pt, Cloud=demesh.Vertices)  # -> ClosestPoint, CPIndex, Distance
panel_2 = Panel(cp.CPIndex)

# ---- group: SHOULDER POMS
item = ListItem(List=demesh.Vertices, Index="10681", Wrap=True)
item_2 = ListItem(List=demesh.Vertices, Index="10559", Wrap=True)
ln = Line(StartPoint=item, EndPoint=item_2)

# ---- group: HIP POMS
item_3 = ListItem(List=demesh.Vertices, Index="5965", Wrap=True)
item_4 = ListItem(List=demesh.Vertices, Index="6025", Wrap=True)
ln_2 = Line(StartPoint=item_3, EndPoint=item_4)

# ---- group: KNEES
item_5 = ListItem(List=demesh.Vertices, Index="2826", Wrap=True)
item_6 = ListItem(List=demesh.Vertices, Index="2573", Wrap=True)
item_7 = ListItem(List=demesh.Vertices, Index="2645", Wrap=True)
item_8 = ListItem(List=demesh.Vertices, Index="2461", Wrap=True)
ln_3 = Line(StartPoint=item_7, EndPoint=item_8)
ln_4 = Line(StartPoint=item_5, EndPoint=item_6)
midpt = CurveMiddle(Curve=ln_4)
midpt_2 = CurveMiddle(Curve=ln_3)

# ---- group: FEET
item_9 = ListItem(List=demesh.Vertices, Index="451", Wrap=True)
item_10 = ListItem(List=demesh.Vertices, Index="282", Wrap=True)
item_11 = ListItem(List=demesh.Vertices, Index="361", Wrap=True)
item_12 = ListItem(List=demesh.Vertices, Index="235", Wrap=True)
ln_5 = Line(StartPoint=item_10, EndPoint=item_9)
ln_6 = Line(StartPoint=item_12, EndPoint=item_11)

# ---- group: TORSO
midpt_3 = CurveMiddle(Curve=ln)
midpt_4 = CurveMiddle(Curve=ln_2)
ln_7 = Line(StartPoint=midpt_3, EndPoint=midpt_4)

# ---- group: HEAD AND NECK
item_13 = ListItem(List=demesh.Vertices, Index="12456", Wrap=True)
item_14 = ListItem(List=demesh.Vertices, Index="11115", Wrap=True)
item_15 = ListItem(List=demesh.Vertices, Index="11293", Wrap=True)
ln_8 = Line(StartPoint=item_14, EndPoint=item_15)
midpt_5 = CurveMiddle(Curve=ln_8)
ln_9 = Line(StartPoint=midpt_3, EndPoint=midpt_5)
ln_10 = Line(StartPoint=item_13, EndPoint=midpt_5)

# ---- group: LEGS
ln_11 = Line(StartPoint=midpt_4, EndPoint=item_3)
ln_12 = Line(StartPoint=midpt_4, EndPoint=item_4)
ln_13 = Line(StartPoint=midpt, EndPoint=item_10)
ln_14 = Line(StartPoint=midpt_2, EndPoint=item_12)
midpt_6 = CurveMiddle(Curve=ln_11)
midpt_7 = CurveMiddle(Curve=ln_12)
ln_15 = Line(StartPoint=midpt_6, EndPoint=midpt)
ln_16 = Line(StartPoint=midpt_7, EndPoint=midpt_2)
